# Grasshopper definition QQ_00.gh (Grasshopper 1.0.7)
# plug-ins: Hops, MeshEdit Components, Geospatial, Urbano, Human

# VKO_border
path = FilePath("C:\WORK_RDplus\EastKz\VKO2_border_32645.geojson")
# QQ_border
path_2 = FilePath("C:\WORK_RDplus\EastKz\QQ_border_32645.geojson")
readjson = ReadGeoJSON(File=path)  # -> Type, simplify(Geometry), Keys, Values
readjson_2 = ReadGeoJSON(File=path_2)  # -> Type, simplify(Geometry), Keys, Values
path_3 = FilePath("C:\WORK_RDplus\EastKz\QQ_border_32645.shp")
meta = CreateMetadata(KeysInMetadata=readjson.Keys, ValuesInMetadata=simplify(readjson.Values))
branch = TreeBranch(Tree=simplify(readjson.Keys), Path="{0}", MaintainPaths=True)
importosm = ImportOSMFeatures(OSMPathOrURL=path_3, OSMFeatureType="boundary", Format="pbf", ImportAltitude=False)  # -> Points, Metadata, UTMZone, TranslationVector
crv = Curve(readjson.Geometry)
panel = Panel(branch)
runion = RegionUnion(Curves=flatten(crv))
crv_2 = Curve(readjson_2.Geometry)
item = ListItem(List=panel, Index=0, Wrap=True)

# ----
# make boundary area
cp = ControlPoints(Curve=crv_2)  # -> Points, Weights, Knots
bnd = Bounds2D(Coordinates=cp.Points)
dedom2 = DeconstructDomain²(Domain=bnd)  # -> UComponent, VComponent
dedomain = DeconstructDomain(Domain=dedom2.UComponent)  # -> Start, End
dedomain_2 = DeconstructDomain(Domain=dedom2.VComponent)  # -> Start, End
pt = ConstructPoint(XCoordinate=dedomain.Start, YCoordinate=dedomain_2.Start, ZCoordinate=0)
pt_2 = ConstructPoint(XCoordinate=dedomain.End, YCoordinate=dedomain_2.End, ZCoordinate=0)
rec_2pt = Rectangle2Pt(Plane=PlaneXY(0, 0, 0), PointA=pt, PointB=pt_2, Radius=0)  # -> Rectangle, Length

lookup = LookupMetadata(MetadataGeometry=meta, SearchKey=item)  # -> flatten(Value)
geo = Geometry(crv_2)
geo_2 = Geometry(runion)
previewlw = CustomPreviewLineweights(Geometry=geo, Shader=ColourSwatch(SwatchColor=RGB(235, 119, 255)), Thickness="0.5", Absolute=False)
previewlw_2 = CustomPreviewLineweights(Geometry=geo_2, Shader=ColourSwatch(SwatchColor=RGB(199, 228, 255)), Thickness="0.2", Absolute=False)
Z = UnitZ(Factor=1)
vec = Vector(Z)

# ----
# Ctrl C + Ctrl V from
#  https://boundingbox.klokantech.com/
# rectangle to extract
#  maps from
https_boundingbox_klokantech_com_exporte = Panel("83.8555,48.9433,87.3492,49.8407")  # "https://boundingbox.klokantech.com/ exported as CSV"

split = TextSplit(Text=https_boundingbox_klokantech_com_exporte, Separators=",")
item_2 = ListItem(List=split, Index=0, Wrap=True)  # -> Item, Item1, Item2, Item3
pt_3 = ConstructPoint(XCoordinate=item_2.Item2, YCoordinate=item_2.Item3, ZCoordinate=0)
pt_4 = ConstructPoint(XCoordinate=item_2.Item, YCoordinate=item_2.Item1, ZCoordinate=0)
rec_2pt_2 = Rectangle2Pt(Plane=PlaneXY(0, 0, 0), PointA=pt_4, PointB=pt_3, Radius=0)  # -> Rectangle, Length

# ----
# dam to
# renew data
# incrementally
dam = DataDam(DataA=rec_2pt_2.Rectangle, BufferDelay=10000000, BufferMode=0)

# ----
# map poligon defined
crv_3 = Curve(flatten(dam))

panel_2 = Panel(crv_3)

crv_4 = Curve(rec_2pt.Rectangle)
disc = Discontinuity(Curve=crv_4, Level=1)  # -> Points, Parameters
panel_3 = Panel("COPERNICUS/CORINE/V20/100m/2012")
projpt = ProjectGeographicPoint(Point=disc.Points, Projection="UTM -> WSG84", UTMZone="18F")  # -> Out, UTMZone
panel_4 = Panel("landcover")

# ----
# .../ee_image
hops = Hops(
    Layer="CGIAR/SRTM90_V4",
    Bands="elevation",
    Mode="mean",
    Scale=Slider(1000000, range=100..1000000),
    Pts=projpt.Out,
    CacheResultsInMemory=True,
    CacheSolveResults=True,
    RemoteDefinitionLocation="http://127.0.0.1:5000/ee_image",
    RemoteSolveVersion=(0, 1, 0),
    ShowInput_Enabled=False,
    ShowInput_Path=False,
    SynchronousSolve=False)  # -> Values, W, H

bnd_2 = Bounds(Numbers=hops.Values)
dedomain_3 = DeconstructDomain(Domain=bnd_2)  # -> Start, End
gradient = Gradient(
    LowerLimit=dedomain_3.Start,
    UpperLimit=dedomain_3.End,
    Parameter=hops.Values,
    stops=[0: RGB(243, 57, 0), 0.1: RGB(236, 27, 60), 0.2: RGB(210, 0, 118), 0.3: RGB(103, 0, 120), 0.4: RGB(39, 72, 161), 0.5: RGB(1, 192, 229), 0.6: RGB(18, 178, 90), 0.7: RGB(79, 186, 8), 0.8: RGB(220, 237, 32), 0.9: RGB(247, 159, 20), 1: RGB(0, 0, 0)])

# ----
# .../ee_image
panel_5 = Panel("CGIAR/SRTM90_V4")
disc_2 = Discontinuity(Curve=crv_3, Level=1)  # -> Points, Parameters
reproj = Hops(
    Points=disc_2.Points,
    Bool=Toggle(True),
    CacheResultsInMemory=False,
    CacheSolveResults=False,
    RemoteDefinitionLocation="http://127.0.0.1:5000/reproject_UTM",
    RemoteSolveVersion=(0, 1, 0),
    ShowInput_Enabled=False,
    ShowInput_Path=False,
    SynchronousSolve=False)
hops_2 = Hops(
    Layer=panel_5,
    Bands="elevation",
    Mode="mean",
    Scale=Slider(1000, range=0..1000),
    Pts=disc_2.Points,
    CacheResultsInMemory=True,
    CacheSolveResults=True,
    RemoteDefinitionLocation="http://127.0.0.1:5000/ee_image",
    RemoteSolveVersion=(0, 1, 0),
    ShowInput_Enabled=False,
    ShowInput_Path=False,
    SynchronousSolve=False)  # -> Values, W, H
bnd_3 = Bounds(Numbers=hops_2.Values)
dedomain_4 = DeconstructDomain(Domain=bnd_3)  # -> Start, End
num = Number(3)
gradient_2 = Gradient(
    LowerLimit=dedomain_4.Start,
    UpperLimit=dedomain_4.End,
    Parameter=hops_2.Values,
    stops=[0: RGB(255, 255, 255), 1: RGB(0, 0, 0)])
multiplication = Multiplication(A=hops_2.Values, B=Slider(1, range=1..5))
Z_2 = UnitZ(Factor=multiplication)

move = Move(Geometry=reproj, Motion=vec)  # -> Geometry, Transform

pline = PolyLine(Vertices=reverse(move.Geometry), Closed=invert(False))
mplane = MeshPlane(Boundary=pline, WidthCount=hops_2.W, HeightCount=hops_2.H)  # -> Mesh, Area
demesh = DeconstructMesh(Mesh=mplane.Mesh)  # -> Vertices, Faces, Colours, Normals
move_2 = Move(Geometry=demesh.Vertices, Motion=Z_2)  # -> Geometry, Transform
conmesh = ConstructMesh(Vertices=move_2.Geometry, Faces=demesh.Faces, Colours=gradient_2)
contour = Contour(Shape=conmesh, Point=Point(0, 0, 0), Direction=Vector(0, 0, 1), Distance="50")

bnd_4 = Bounds(Numbers=multiplication)
dedomain_5 = DeconstructDomain(Domain=bnd_4)  # -> Start, End
data = Data(conmesh)
mint = MeshIntersection(MeshesA=data)

# ---- group: .../reproject_UTM
reproj_2 = Hops(
    Points=projpt.Out,
    Bool=Toggle(True),
    CacheResultsInMemory=False,
    CacheSolveResults=False,
    RemoteDefinitionLocation="http://127.0.0.1:5000/reproject_UTM",
    RemoteSolveVersion=(0, 1, 0),
    ShowInput_Enabled=False,
    ShowInput_Path=False,
    SynchronousSolve=False)

# ----
pline_2 = PolyLine(Vertices=reverse(reproj_2), Closed=invert(False))
mplane_2 = MeshPlane(Boundary=pline_2, WidthCount=hops.W, HeightCount=hops.H)  # -> Mesh, Area

int = Integer(hops.Values)
Z_3 = UnitZ(Factor=int)
cset = CreateSet(List=int)  # -> Set, Map
explode = MeshExplode(Mesh=mplane_2.Mesh, Interpolate=False)
move_3 = Move(Geometry=explode, Motion=Z_3)  # -> Geometry, Transform

demesh_2 = DeconstructMesh(Mesh=mplane_2.Mesh)  # -> Vertices, Faces, Colours, Normals
conmesh_2 = ConstructMesh(Vertices=demesh_2.Vertices, Faces=demesh_2.Faces, Colours=gradient)
